# Grasshopper definition 01 Simple Input and Maths.gh (Grasshopper 1.0.4)

# ---- group: Various objects for manually defining numeric and textual values
# There are lots of special objects
# for inputting values. You will find
# most of them in the PARAMS tab,
# INPUT panel.
C = DigitScroller(Scroller_Digits=12, Scroller_Prefix="C", Scroller_Radix=10, Scroller_Value=1.3)
B = Slider(1.25, range=0..10)
equation_format = Panel("({0} + {1}) / {2}")
A = ControlKnob(Decimals=2, Limit=True, Maximum=10, Minimum=0, Range=1, Value=0.25)

# ---- group: Combine various values according to a formatting rule
format = Format(Format=equation_format, Culture=127, Data0=A, Data1=B, Data2=C)

# ----
# Panels are a great way to inspect your
# values, just be careful to not insert them
# into the data-flow. Panels convert all data
# to text, which may lead to loss of accuracy.
formatting_result = Panel(format)

# ---- group: Resolve equation by running it through a Number parameter
# If the provided data is of a different type
# than the required data, it will often get
# automatically converted. In this case text
# is re-interpreted as a numeric value.
# 
# Some auto-conversions are more
# sensible than others, be careful when
# making files that rely on this 'silent'
# feature.
num = Number(format)
equation_result = Panel(num)
