# Grasshopper definition 02 Interpolating Values.gh (Grasshopper 1.0.4)

# ---- group: Define interpolation samples
# If the GUMBALLS option is enabled
# in the DISPLAY menu, then selecting
# this parameter will allow you to
# manually drag the points around.
samples = Slider(100, range=10..500)
range = Range(Domain=Domain(0, 1), Steps=samples)

# ---- group: Define 3 colours
A = ColourSwatch(SwatchColor=RGB(201, 12, 88))
# Click on the colour swatches
# to modify the colours.
C = ColourSwatch(SwatchColor=RGB(29, 196, 185))
B = ColourSwatch(SwatchColor=RGB(255, 185, 20))
col = Colour([A, B, C])

# ---- group: Define 5 points
# ← This double wire indicates more
#     than one value is being transmitted.
pt = Point([Point(2, -1, 0), Point(-2, 8, 0), Point(11, 10, 0), Point(10, -1, 0), Point(20, 3, 0)])

# ---- group: Interpolate points
interp = InterpolateData(Data=pt, Parameter=range, Interpolation=4)

# ---- group: Interpolate colours
# Components with black labels usually
# have additional options in their menus.
# In this case you can set the interpolation
# scheme.
interp_2 = InterpolateData(Data=col, Parameter=range, Interpolation=2)

# ---- group: Display coloured points
# This component lets you display
# geometry with custom colours.
preview = CustomPreview(Geometry=interp, Material=interp_2)
