# Grasshopper definition 03 Wires and Conversions.gh (Grasshopper 1.0.4)

swatch = ColourSwatch(SwatchColor=RGB(153, 232, 146))
swatch_2 = ColourSwatch(SwatchColor=RGB(46, 217, 217))
# ← Hold down SHIFT to connect all swatches
#    with the colour parameter. You can
#    remove existing connections by tracing
#    them whilst holding CONTROL.
swatch_3 = ColourSwatch(SwatchColor=RGB(10, 2, 163))
swatch_4 = ColourSwatch(SwatchColor=RGB(224, 63, 200))
# Always use a single source of data for values that
# are supposed to be identical. Related values should
# also ideally come from a single master value.
# Here, we always want exactly twice as many quads
# horizontally as vertically.
# You can insert 'expressions' inside →
# inputs to efficiently modify values.
mesh_density = Slider(40, range=10..60)
# If the automatic conversion isn't to your liking,
# you can always define a custom scheme.
# Here we want to map Hue and Luminance onto
# X and Y, instead of the standard RGB → XYZ.
col = Colour([ColourSwatch(SwatchColor=RGB(178, 29, 29)), ColourSwatch(SwatchColor=RGB(232, 193, 21))])

# ---- group: Colour to coordinate conversion
ahsl = SplitAHSL(Colour=col)  # -> Alpha, Hue, Saturation, Luminance
pt = ConstructPoint(XCoordinate=expr("x*20", ahsl.Hue), YCoordinate=expr("x*10", ahsl.Luminance), ZCoordinate=0)

# ----
mplane = MeshPlane(
    Boundary={Plane=PlaneXY(10, 5, 0), Size=Domain2(u=-10..10, v=-5..5)},
    WidthCount=expr("x*2", mesh_density),
    HeightCount=mesh_density)  # -> Mesh, Area
mspray = MeshSpray(Mesh=mplane.Mesh, Points=pt, Colours=col, SprayMode=11)
