# Grasshopper definition 04 Polynomial Graphing with Derivatives.gh (Grasshopper 1.0.4)

# ---- group: Polynomial factors
quartic_factor = Slider(0.02, range=-0.2..0.2)
cubic_factor = Slider(0.05, range=-0.5..0.5)
quadratic_factor = Slider(-0.3, range=-1..1)
linear_factor = Slider(-0.8, range=-4..4)

# ---- group: Define sampling domain
# Since standard mathematical notation
# is difficult to type, instead of this:
#     f(x) = ax⁴ + bx³ + cx² + dx
# we have to use a less pretty, but
# more keyboard friendly approach.
range = Range(Domain="-5 to +5", Steps=250)

# ---- group: Evaluate polynomial
expression = Expression(x=range, a=quartic_factor, b=cubic_factor, c=quadratic_factor, d=linear_factor, Expression="a*x^4 + b*x^3 + c*x^2 + d*x")

# ---- group: Evaluate derivative and map onto colour gradient
# Although Grasshopper is capable of evaluating
# many equations, it lacks the mathematical
# capabilities of programs such as Maple or
# Mathematica. Prepare to dust off your
# old high school calculus books.
expression_2 = Expression(
    x=range,
    a=quartic_factor,
    b=cubic_factor,
    c=quadratic_factor,
    d=linear_factor,
    Expression="4*a*x^3 + 3*b*x^2 + 2*c*x + d")
gradient = Gradient(
    LowerLimit=-10,
    UpperLimit=10,
    Parameter=expression_2,
    stops=[0: RGB(234, 38, 0), 0.301: RGB(234, 126, 0), 0.5: RGB(254, 244, 84), 0.734: RGB(173, 203, 249), 1: RGB(75, 107, 169)])

# ---- group: Combine X and Y coordinates
# This component is hidden (dark grey).
# You can enable/disable the preview of
# components from within their menus.
pt = ConstructPoint(XCoordinate=range, YCoordinate=expression, ZCoordinate=0)

# ---- group: Display coloured points
preview = CustomPreview(Geometry=pt, Material=gradient)
