# Grasshopper definition 05 Measure and Display Values.gh (Grasshopper 1.0.4)

# ---- group: Define a circle through 3 points
# You can define individual values
# or large groups of values in each
# parameter object.
pt = Point(Point(0, 10, 0))
pt_2 = Point(Point(15, 20, 0))
pt_3 = Point(Point(15, 5, 0))
circle = Circle3Pt(PointA=pt, PointB=pt_3, PointC=pt_2)  # -> Circle, Plane, Radius

# ---- group: Define a cloud of points
pt_4 = Point([Point(19.83155331, 20.37749236, 0), Point(21.98991699, 20.88534263, 0), Point(22.1930571, 19.51414689, 0), Point(20.77107632, 19.46336186, 0), Point(21.73599185, 18.57462387, 0), Point(23.18336514, 20.04738968, 0)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])

# ---- group: Measure deviation for each point
crv_cp = CurveClosestPoint(Point=pt_4, Curve=circle.Circle)  # -> Point, Parameter, Distance

# ---- group: Format and display average deviation inside the circle
avr = Average(Input=crv_cp.Distance)
format = Format(Format="{0:0.00} mm", Culture=127, Data0=avr)
pt_5 = Point(circle.Circle)
# The DISPLAY tab contains various components
# for visualising data both in Rhino viewports and
# the Grasshopper canvas. But there are plug-ins
# available that offer more functionality. Be sure
# to check out www.food4rhino.com
# Text Tags can be used to display
# information in the Rhino viewport,
# instead of on the Grasshopper canvas.
# Sometimes you must sort, reverse,
# re-order or cull values before you can
# meaningfully display them.
# The MATHS and SETS tabs contain
# many components for statistical and
# logical operations on data.
tag = TextTag3D(Location=pt_5, Text=format, Size=1.5, Justification=5)

# ---- group: Sort all distances and graph them
sort = SortList(Keys=crv_cp.Distance)  # -> Keys, ValuesA
graph = QuickGraph(sort.Keys)

# ---- group: Bar graph of distances
bar_graph = BarGraph(crv_cp.Distance, BarColor=RGB(255, 0, 90))
