# Grasshopper definition 06 Adaptive Pattern within Shape.gh (Grasshopper 1.0.4)

# ---- group: Half shape
# Symmetry can be defined as
# a transformation, in which case
# it remains a 'live' part of a file.
pt = Point([Point(0, 0, 0), Point(15, 0, 0), Point(20, 10, 0), Point(20, 30, 0), Point(10, 45, 0), Point(0, 45, 0)])
nurbs = NurbsCurve(Vertices=pt, Degree=3, Periodic=False)  # -> Curve, Length, Domain

# ---- group: Mirror and join to create full shape
mirror = Mirror(Geometry=nurbs.Curve, Plane=PlaneYZ(0, 0, 0))  # -> Geometry, Transform
join = JoinCurves(Curves=[nurbs.Curve, mirror.Geometry], Preserve=False)

# ---- group: Measure bounds of full shape
# Finding the horizontal and
# vertical extent of a shape can
# be done using bounding boxes.
bbox = BoundingBox(Content=join, Plane=PlaneXY(0, 0, 0))  # -> Box, Box_2
box_corners = BoxCorners(Box=bbox.Box)  # -> CornerA, CornerB, CornerC, CornerD, CornerE, CornerF, CornerG, CornerH
dist = Distance(PointA=box_corners.CornerC, PointB=box_corners.CornerD)
dist_2 = Distance(PointA=box_corners.CornerE, PointB=box_corners.CornerG)

# ---- group: Make big enough grid
# RELAY objects can be used to organise
# the wiring in a file. Double click on wires
# to insert them, and double click on relays
# to remove them.
hexgrid = Hexagonal(Plane=box_corners.CornerA, Size=1.5, ExtentX=expr("x/2", dist), ExtentY=expr("x/3", dist_2))  # -> Cells, flatten(Points)

# ---- group: Remove exterior points
incurve = PointInCurve(Point=hexgrid.Points, Curve=join)  # -> Relationship, Point
cull = CullPattern(List=hexgrid.Points, CullPattern=incurve.Relationship)

# ---- group: Measure and normalise distance to boundary curve
# Since distances can be any positive
# value, sometimes it's a good idea to
# 'remap' your numbers into a fixed domain.
# This makes subsequent mathematics
# easier to write.
crv_cp = CurveClosestPoint(Point=cull, Curve=join)  # -> Point, Parameter, Distance
bnd = Bounds(Numbers=crv_cp.Distance)
remap = RemapNumbers(Value=crv_cp.Distance, Source=bnd, Target=Domain(0, 1))  # -> Mapped, Clipped

# ---- group: Create circles based on modified, normalised distance
graph = GraphMapper(
    remap.Mapped,
    x0=0,
    x1=1,
    y0=0.2,
    y1=1,
    container_name="Bezier",
    cpx=[0, 0.6108490825, 0.2806603909, 1],
    cpy=[0, 0, 0.6578947306, 1])
cir = Circle(Plane=cull, Radius=graph)
